# Grasshopper definition Belt_generator.gh (Grasshopper 1.0.7)

number_slider = Slider(2.6, range=0..10)
len = Length(Curve=<geometry referenced from the Rhino model>)
crv = Curve(<curve referenced from the Rhino model>)
panel = Panel(len)
len_2 = Length(Curve=crv)
division = Division(A=len_2, B=len)
division_2 = Division(A=len, B=len_2)
divide = DivideCurve(Curve=crv, Count=Slider(112, range=0..1000), Kinks=False)  # -> Points, Tangents, Parameters
panel_2 = Panel(division)
series = Series(Start=0, Step=division_2, Count=panel_2)
shatter = Shatter(Curve=crv, Parameters=series)
